# Grasshopper definition snapPolylinesTogrid.gh (Grasshopper 1.0.7)
# plug-ins: Human, Pufferfish

grid_size = Slider(37, range=1..140)

crv = Curve([<curve referenced from the Rhino model> x12])
explode = Explode(Curve=crv, Recursive=True)  # -> Segments, Vertices
python = GhPythonScript(pts=explode.Vertices, gridSize=grid_size, angleThreshold=Slider(10, range=1..30))  # -> out, rationalizedPolyline; inputs pts: list of Point3d
# ---------- python: Python ----------
__author__ = "panz"
__version__ = "2025.01.30"


import rhinoscriptsyntax as rs
import math

def snap_to_grid(vertices, grid_size):
    snapped_vts = []

    for vertex in vertices:
        # Snap each vertex (x, y) to the nearest grid point
        snapped_vertex = (
            round(vertex[0] / grid_size) * grid_size,
            round(vertex[1] / grid_size) * grid_size
        )
        snapped_vts.append(snapped_vertex)
    
    return snapped_vts


def straighten_lines(vertices):
    new_vertices = [vertices[0]]  # Start with the first vertex

    for i in range(1, len(vertices) - 1):
        x1, y1 = new_vertices[-1]
        x2, y2 = vertices[i]
        x3, y3 = vertices[i + 1]

        # Calculate angle of segment (x1, y1) -> (x2, y2)
        dx = x2 - x1
        dy = y2 - y1

        if dx == 0:  # Vertical line
            angle = 90
        else:
            angle = abs(math.degrees(math.atan2(dy, dx)))

        # Snap angles close to 0 or 90 degrees
        if 0 <= angle <= threshold or 90-threshold <= angle < 90:
            if abs(dy) > abs(dx):  # Make it vertical
                x2 = x1
            else:  # Make it horizontal
                y2 = y1

        new_vertices.append((x2, y2))

    new_vertices.append(vertices[-1])  # Append the last vertex
    return new_vertices


# Example usage:
threshold = angleThreshold
grid_size = gridSize  # Define your grid size
vertices = pts  # Your input vertices


# Step 1: Snap to grid
snapped_pts = snap_to_grid(vertices, grid_size)

# Step 2: Straighten lines
final_pts = straighten_lines(snapped_pts)

# Step 3: Create the corrected polyline in Rhino
snappedPolyline = rs.AddPolyline(final_pts)

rationalizedPolyline =snappedPolyline
#print (rationalizedPolyline)
# ---------- end python ----------
previewlw = CustomPreviewLineweights(Geometry=crv, Shader=ColourSwatch(SwatchColor=RGB(247, 0, 0)), Thickness=Slider(1.042, range=0..8), Absolute=False)
crv_2 = Curve(python.rationalizedPolyline)
previewlw_2 = CustomPreviewLineweights(Geometry=crv_2, Shader=ColourSwatch(SwatchColor=RGB(82, 247, 0)), Thickness=Slider(5.425, range=0..8), Absolute=False)

brec = BoundingRectangle(Geometry=crv, Plane=PlaneXY(0, 0, 0), Axis=0, Slide=0, Union=True)  # -> Bounding, DimensionX, DimensionY
explode_2 = Explode(Curve=brec.Bounding, Recursive=True)  # -> Segments, Vertices
integer_division = IntegerDivision(A=brec.DimensionY, B=grid_size)
integer_division_2 = IntegerDivision(A=brec.DimensionX, B=grid_size)
addition = Addition(A=integer_division_2, B="100")
addition_2 = Addition(A=integer_division, B="100")
panel = Panel(addition)
panel_2 = Panel(addition_2)
item = ListItem(List=explode_2.Vertices, Index=Slider(0, range=0..112), Wrap=True)
recgrid = Rectangular(Plane=item, SizeX=grid_size, SizeY=grid_size, ExtentX=panel, ExtentY=panel_2)  # -> Cells, Points

explode_3 = Explode(Curve=crv, Recursive=True)  # -> Segments, Vertices
python_2 = GhPythonScript(x=explode_3.Vertices, gridSize=grid_size)  # -> out, initialPolyline, snappedPolyline; inputs x: list of Point3d
# ---------- python_2: Python ----------
__author__ = "panz"
__version__ = "2025.01.30"

import rhinoscriptsyntax as rs
vertices = []
for item in x:
    vertices.append(item)
vertices.append(vertices[0])
#draw the initiial polyline
polyline = rs.AddPolyline(vertices)

initialPolyline = polyline


def snap_to_grid(vertices, grid_size):
    snapped_polyline = []
    snapped_vts = []

    for vertex in vertices:
        # Snap each vertex (x, y) to the nearest grid point
        snapped_vertex = (
            round(vertex[0] / grid_size) * grid_size,
            round(vertex[1] / grid_size) * grid_size
        )
        snapped_vts.append(snapped_vertex)
        
    return snapped_vts


# Example usage:
    
grid_size = gridSize
updatedPts = snap_to_grid(vertices, grid_size)
snappedPolyline = rs.AddPolyline(updatedPts)
# ---------- end python_2 ----------

show_grid = BooleanToggle(False)
gate = StreamGate(Stream=recgrid.Cells, Gate=show_grid)  # -> Target0, Target1
previewlw_3 = CustomPreviewLineweights(
    Geometry=gate.Target1,
    Shader=ColourSwatch(SwatchColor=RGB(79, 79, 79)),
    Thickness=Slider(1.884, range=0..8),
    Absolute=False)

previewlw_4 = CustomPreviewLineweights(
    Geometry=python_2.initialPolyline,
    Shader=ColourSwatch(SwatchColor=RGB(247, 0, 0)),
    Thickness=Slider(4.41, range=0..8),
    Absolute=False)

previewlw_5 = CustomPreviewLineweights(
    Geometry=python_2.snappedPolyline,
    Shader=ColourSwatch(SwatchColor=RGB(0, 247, 41)),
    Thickness=Slider(8, range=0..8),
    Absolute=False)

area = Area(Geometry=python_2.snappedPolyline)  # -> Area, Centroid
area_2 = Area(Geometry=python_2.initialPolyline)  # -> Area, Centroid
panel_3 = Panel(area.Area)
panel_4 = Panel(area_2.Area)
division = Division(A=area_2.Area, B=area.Area)
subtraction = Subtraction(A=area_2.Area, B=area.Area)
multiplication = Multiplication(A=division, B=100)
panel_5 = Panel(subtraction)
