# Grasshopper definition ReadJsonAndCreateGeometry_3python.gh (Grasshopper 1.0.7)
# plug-ins: Pufferfish, Speckle 2, Kangaroo2 Components, Human, LunchBox

list = ValueList({"select single item (Wall panel)": 0, "select multiple items (Wall panel)": 1}, selected="select multiple items (Wall panel)")

# ---- group: hackathon_candidateDesign1
path = FilePath("C:\Users\panz\Downloads\floorplan.json")

# ----
select_item = Slider(41, range=0..46)
path_2 = FilePath("C:\Users\panz\Documents\GitHub\IBC\05_Flooplan_processing_ve0_1\jsonExports\apartment.json")
path_3 = FilePath("C:\Users\panz\Documents\GitHub\IBC\05_Flooplan_processing_ve0_1\jsonExports\apartment.json")
path_4 = FilePath("C:\Users\panz\Documents\GitHub\IBC\05_Flooplan_processing\jsonExports\panels_oneApt_EP_update1_withRoomOutlineEDITED.json")

# ---- group: KEMPS_JSON_test FILE
path_5 = FilePath("C:\Users\panz\Documents\GitHub\IBC\05_Flooplan_processing\jsonExports\panels_oneApt_EP_update1_withRoomOutlineEDITED.json")

# ---- group: hackathon_test FILE
path_6 = FilePath("C:\Users\panz\Documents\GitHub\2025-AEC-Hackathon\json\ReferenceDesign_01\floorplan.json")

# ----
panel = Panel(path_6)
series = Series(Start=0, Step=1, Count=select_item)
filter = StreamFilter(Gate=list, Stream0=select_item, Stream1=series)

python = GhPythonScript(file=path_6)  # -> out, apartmentNames, roomTypes, roomPolylines, roomSurfaces, roomColors
# ---------- python: Python ----------
__author__ = "panz"
__version__ = "2024.11.11"

import rhinoscriptsyntax as rs
import json
import json
import Rhino.Geometry as rg

# Read and parse JSON data from the file
with open(file, 'r') as inputfile:
    data = json.load(inputfile)

# Extract panels (walls) data
panels_data = data.get("panels", {}).get("items", {})
if not panels_data:
    print("Warning: 'panels.items' key is missing or empty in JSON.")
    
# Extract apartment outlines from 'spaces'
spaces_data = data.get("spaces", {})
roomOutlines = []
roomPolylines =[]
apartmentNames = []
roomTypes = []
roomColors = []
roomSurfaces = []

for space_id, space in spaces_data.items():
    coordinates = space.get("coordinates")
    roomTypes.append(space.get("room_type"))
    apartmentNames.append(space.get("apartment"))
    outline_points = [[point["x"], point["y"], point["z"]] for point in coordinates]
    roomOutlines.append(outline_points)
print (len(roomOutlines))


roomCounter = 0 
for index in range (0, len(spaces_data)):
    roomOutline = roomOutlines[index] 
    
    # Convert the point lists into Rhino Point3d objects
    polyline_points = [rg.Point3d(point[0], point[1], point[2]) for point in roomOutline]
    # Create the polyline using the list of Point3d objects
    polyline = rg.Polyline(polyline_points)
    
    
    #assign colors based on roomput
    if (roomTypes[index] == "living_room"):
        roomColors.append('255,100,0')
    elif (roomTypes[index] == "bedroom"):
        roomColors.append('153,137,255')
    elif (roomTypes[index] == "kitchen"):
        roomColors.append('0,0,220')
    elif (roomTypes[index] == "bathroom"):
        roomColors.append('151,255,255')
    elif (roomTypes[index] == "core"):
        roomColors.append('150,150,150')
        
    # create a surface
    roomSrfs = rg.Brep.CreatePlanarBreps(polyline.ToNurbsCurve())
    roomSurfaces.append(roomSrfs[0])
    # Ensure the polyline is closed if necessary (optional)
    if not polyline.IsClosed:
        polyline.Add(polyline[0])  # Add the first point to close the polyline
    # Output the polyline (e.g., to Grasshopper)
    roomPolylines.append(polyline)
    roomCounter +=1 
    print ("created", roomCounter, "space polylines")
    print(roomSurfaces)
# ---------- end python ----------
crv = Curve(python.roomPolylines)
brep = Brep(python.roomSurfaces)

series_2 = Series(Start=0, Step=1, Count=Slider(1, range=0..10))
item = ListItem(List=crv, Index=series_2, Wrap=True)

# ----
# GET WALL PROPERTIES
python_2 = GhPythonScript(file=path_6, panelIndex=filter)  # -> out, PanelType, StartPoint, EndPoint, Height, Thickness, RoomType, ApartmentName; inputs panelIndex: Int32
# ---------- python_2: Python ----------
__author__ = "panz"
__version__ = "2024.11.11"

import rhinoscriptsyntax as rs
import json
import json
import Rhino.Geometry as rg

# Read and parse JSON data from the file
with open(file, 'r') as inputfile:
    data = json.load(inputfile)

# Extract panel information
panels = data["panels"]["items"]
if not panels:
    print("Warning: 'panels.items' key is missing or empty in JSON.")
    
# Extract apartment outlines from 'spaces'
spaces_data = data.get("spaces", {})


# Initialize lists to store panel data
panel_types = []
start_points = []
end_points = []
heights = []
thicknesses = []
roomTypes = []
apartmentNames = []



# Loop through each panel and extract relevant information
for key, panel in panels.items():
    panel_types.append(panel.get("panel_type"))
    start_points.append(panel.get("start_point"))
    end_points.append(panel.get("end_point"))
    heights.append(panel.get("height"))
    thicknesses.append(panel.get("thickness"))
    roomTypes.append(panel.get("room"))
    apartmentNames.append(panel.get("apartment", "N/A"))          # Default: "N/A"


# Assume 'index' is passed as an argument (in a Grasshopper environment, for example)

PanelType = panel_types[panelIndex]
StartPoint = start_points[panelIndex]
EndPoint = end_points[panelIndex]
Height = heights[panelIndex]
Thickness = thicknesses[panelIndex]
RoomType = roomTypes[panelIndex]
ApartmentName = apartmentNames[panelIndex]



print("Panel Type:", PanelType)
print("Start Point:", StartPoint)
print("End Point:", EndPoint)
print("Height:", Height)
print("Thickness:", Thickness)
print("Room Type:", RoomType)
print("Apartment:", ApartmentName)
# ---------- end python_2 ----------

number_slider = Slider(12, range=0..12)
item_2 = ListItem(List=crv, Index=Slider(12, range=0..12), Wrap=True)
series_3 = Series(Start=0, Step=1, Count=number_slider)
explode = Explode(Curve=item_2, Recursive=True)  # -> Segments, Vertices
strainghten_poly_lin = StrainghtenPolyLin(vec=explode.Segments, pt=explode.Vertices)

number_slider_2 = Slider(0.1, range=0.1..100)
number_slider_3 = Slider(500, range=0..10000)
crv_2 = Curve(item)
pt = Point(Point(0, 0, 0))
brec = BoundingRectangle(Geometry=crv, Plane=PlaneXY(0, 0, 0), Axis=0, Slide=0, Union=True)  # -> Bounding, DimensionX, DimensionY
explode_2 = Explode(Curve=brec.Bounding, Recursive=True)  # -> Segments, Vertices
recgrid = Rectangular(Plane=pt, SizeX=number_slider_2, SizeY=number_slider_2, ExtentX=number_slider_3, ExtentY=number_slider_3)  # -> Cells, Points
item_3 = ListItem(List=explode_2.Vertices, Index=0, Wrap=True)
move2pt = MoveToPoint(Geometry=recgrid.Cells, PointA=pt, PointB=item_3)  # -> Moved, Vector, Transform
pcen = PolygonCenter(Polyline=move2pt.Moved)  # -> CenterV, CenterE, CenterA
incurves = PointInCurves(Point=pcen.CenterV, Curves=crv_2)  # -> Relationship, Index, Point
panel_2 = Panel(incurves.Relationship)
equals = Equality(FirstNumber=incurves.Relationship, SecondNumber="2")  # -> Equality, Inequality
equals_2 = Equality(FirstNumber=incurves.Relationship, SecondNumber="1")  # -> Equality, Inequality
cull = CullPattern(List=move2pt.Moved, CullPattern=equals.Equality)  # -> flatten(List)
or = GateOr(A=equals_2.Equality, B=equals.Equality)

item_4 = ListItem(List=python_2.StartPoint, Index=0, Wrap=True)  # -> Item, Item1, Item2
item_5 = ListItem(List=python_2.EndPoint, Index=0, Wrap=True)  # -> Item, Item1, Item2
Z = UnitZ(Factor=python_2.Height)
pt_2 = ConstructPoint(XCoordinate=item_5.Item, YCoordinate=item_5.Item1, ZCoordinate=item_5.Item2)
pt_3 = ConstructPoint(XCoordinate=item_4.Item, YCoordinate=item_4.Item1, ZCoordinate=item_4.Item2)
ln = Line(StartPoint=pt_3, EndPoint=pt_2)
division = Division(A=python_2.Thickness, B=2)
offcrv = OffsetCurve(Curve=ln, Plane=PlaneXY(0, 0, 0), Distance=graft(division), BothSides=True, Kinks=0, CapType=1)

bake = ObjectBake(
    BakeToggle=number_slider,
    GeometryObjects=strainghten_poly_lin,
    Layer="GH_Bake",
    ObjectName="GH_Obj",
    ObjectColor=RGB(255, 255, 255),
    LayerColor=RGB(255, 255, 255))

# ---- group: tags
show_room_labels = BooleanToggle(True)
room_label_height = Slider(9, range=0..30)
room_labler_color = ColourSwatch(SwatchColor=RGB(0, 255, 0))
room_label_size = Slider(0.265, range=0..50)
area = Area(Geometry=crv)  # -> Area, Centroid
Z_2 = UnitZ(Factor=room_label_height)
move = Move(Geometry=area.Centroid, Motion=Z_2)  # -> Geometry, Transform
concat = Concatenate(FragmentE=python.apartmentNames, FragmentA=python.roomTypes, FragmentC=":", FragmentB=area.Area, FragmentD=" m2")
ln_2 = Line(StartPoint=area.Centroid, EndPoint=move.Geometry)
gate = StreamGate(Stream=move.Geometry, Gate=show_room_labels)  # -> Target0, Target1
gate_2 = StreamGate(Stream=ln_2, Gate=show_room_labels)  # -> Target0, Target1
tag = TextTag3D(Location=gate.Target1, Text=flatten(concat), Size=room_label_size, Colour=room_labler_color, Justification=5)
preview = CustomPreview(Geometry=brep, Material=python.roomColors)
preview_2 = CustomPreview(Geometry=gate_2.Target1, Material=room_labler_color)

# ----
series_4 = Series(Start=0, Step=1, Count=Slider(1, range=0..10))

previewlw = CustomPreviewLineweights(Geometry=item_2, Shader=ColourSwatch(SwatchColor=RGB(247, 0, 0)), Thickness=Slider(4.41, range=0..8), Absolute=False)

element_label_height = Slider(3, range=0..30)
show_info = BooleanToggle(True)
element_label_size = Slider(0.183, range=0..50)
element_label_color = ColourSwatch(SwatchColor=RGB(3, 3, 3))
addition = Addition(A=element_label_height, B=3)
dom = ConstructDomain(DomainStart=element_label_height, DomainEnd=addition)

previewlw_2 = CustomPreviewLineweights(
    Geometry=strainghten_poly_lin,
    Shader=ColourSwatch(SwatchColor=RGB(0, 247, 41)),
    Thickness=Slider(8, range=0..8),
    Absolute=False)

item_6 = ListItem(List=crv, Index=series_4, Wrap=True)

# ---- group: METHOD B
explode_3 = Explode(Curve=item_6, Recursive=True)  # -> Segments, Vertices
rad = Radians(Degrees="90")
rad_2 = Radians(Degrees="0")
runion = RegionUnion(Curves=cull)
or_2 = GateOr(A=rad, B=rad_2)
shift = ShiftList(List=explode_3.Segments, Shift=1, Wrap=False)
explode_4 = Explode(Curve=runion, Recursive=True)  # -> Segments, Vertices
length_line = LengthLine(Line=explode_3.Segments, Strength=Slider(1, range=1..1000))
angle = Angle(LineA=explode_3.Segments, LineB=shift, RestAngle=or_2, Strength=Slider(1, range=1..1000))  # disabled
anchor = Anchor(Point=explode_4.Vertices, Strength=Slider(637, range=1..1000))
bouncysolver = BouncySolver(
    GoalObjects=[length_line, angle, anchor],
    Reset=Button(),
    Threshold=1e-15,
    Tolerance=0.0001,
    Damping=0.99,
    Iterations=10,
    On=True)  # -> I, V, O

# ----
boundary = BoundarySurfaces(Edges=crv)
series_5 = Series(Start=0, Step=1, Count=Slider(4, range=0..5))
item_7 = ListItem(List=crv, Index=series_5, Wrap=True)
brec_2 = BoundingRectangle(Geometry=item_7, Plane=PlaneXY(0, 0, 0), Axis=0, Slide=0, Union=True)  # -> Bounding, DimensionX, DimensionY
boundary_2 = BoundarySurfaces(Edges=brec_2.Bounding)
pull = PullCurve(Curve=item_7, Surface=boundary_2)

eval = EvaluateCurve(Curve=reparameterize(ln), Parameter="0.5")  # -> Point, Tangent, Angle
lng = ListLength(List=eval.Point)
random = Random(Range=dom, Number=lng, Seed=2)
concat_2 = Concatenate(FragmentB=python_2.RoomType, FragmentE=python_2.PanelType)
Z_3 = UnitZ(Factor=random)
move_2 = Move(Geometry=eval.Point, Motion=Z_3)  # -> Geometry, Transform
panel_3 = Panel(concat_2)
ln_3 = Line(StartPoint=eval.Point, EndPoint=move_2.Geometry)
gate_3 = StreamGate(Stream=move_2.Geometry, Gate=show_info)  # -> Target0, Target1
gate_4 = StreamGate(Stream=ln_3, Gate=show_info)  # -> Target0, Target1
tag_2 = TextTag3D(Location=gate_3.Target1, Text=graft(panel_3), Size=element_label_size, Colour=element_label_color, Justification=8)
preview_3 = CustomPreview(Geometry=gate_4.Target1, Material=element_label_color)

extr = Extrude(Base=offcrv, Direction=graft(Z))
cap = CapHoles(Brep=extr)
brep_2 = Brep(flatten(cap))
debrep = DeconstructBrep(Brep=brep_2)  # -> Faces, Edges, Vertices
area_2 = Area(Geometry=debrep.Faces)  # -> Area, Centroid
sort = SortList(Keys=area_2.Area, ValuesA=debrep.Faces)  # -> Keys, reverse(ValuesA), ValuesB
item_8 = ListItem(List=sort.Keys, Index=0, Wrap=True)

# ---- group: Porject_information
cso = CreateSpeckleObject(Name="IBC-Building", selectedKitName="Objects")
cso_2 = CreateSpeckleObject(Name="Implenia_Default", selectedKitName="Objects")
cso_3 = CreateSpeckleObject(Name="Implenia_Default", selectedKitName="Objects")
eso = ExtendSpeckleObject(
    SpeckleObject=cso,
    Building_ID=cso_3,
    Level_ID=cso_2,
    Building_Use="Implenia_Default",
    Building_phase="tbd",
    selectedKitName="Objects")
panel_4 = Panel("In Progress")

# ----
level = Level(
    Name="Level 0",
    Elevation="0",
    SelectedConstructorName="Objects.BuiltElements.Level.ctor(System.String,System.Double)",
    SelectedTypeName="Objects.BuiltElements.Level",
    UseSchemaTag=False,
    UserSetSchemaTag=False,
    seed="d38af342d870281b8f9e")

crv_3 = Curve(crv)
Z_4 = UnitZ(Factor="-0.15")
boundary_3 = BoundarySurfaces(Edges=crv_3)
floor = Floor(
    Outline=crv_3,
    Family="Floor",
    A=boundary_3,
    SelectedConstructorName="Objects.BuiltElements.Floor.ctor(Objects.ICurve,System.Collections.Generic.List`1[Objects.ICurve],System.Collections.Generic.List`1[Speckle.Core.Models.Base])",
    SelectedTypeName="Objects.BuiltElements.Floor",
    UseSchemaTag=False,
    UserSetSchemaTag=False,
    seed="5cc5e3f46eed33223d9a")
extr_2 = Extrude(Base=boundary_3, Direction=Z_4)

# ---- group: wall_parameters
cso_4 = CreateSpeckleObject(Name_EN="Implenia Slab", selectedKitName="Objects")
eso_2 = ExtendSpeckleObject(SpeckleObject=cso_4, Is_External="FALSE", UValue="1.0", selectedKitName="Objects")

# ----
# CLICK TO SELECT AND
# SEND ASSEMBLIES TO SPECKLE
panel_5 = Panel(python_2.PanelType)
panel_6 = Panel(python_2.Height)
list_2 = Accounts(
    {"No account selected": , "Account (panz@zhaw.ch | https://app.speckle.systems)": "https://app.speckle.systems/?id=7b59e40123", "Account (vague@topotheque.com | https://app.speckle.systems)": "https://app.speckle.systems/?id=d442476304"}, selected="Account (panz@zhaw.ch | https://app.speckle.systems)",
    FirstSelectedItem="https://app.speckle.systems/?id=7b59e40123")
panel_7 = Panel("https://app.speckle.systems/projects/b9d01cae98/models/2a663449ba")
message = Panel("testing export walls")
sget = StreamGet(StreamIDURL=panel_7, SpeckleAccount=list_2)

# ---- group: WALL object
rendermaterial = RenderMaterial(
    Opacity=1,
    Metalness=0,
    Roughness=1,
    SelectedConstructorName="Objects.Other.RenderMaterial.ctor(System.Double,System.Double,System.Double,System.Nullable`1[System.Drawing.Color],System.Nullable`1[System.Drawing.Color])",
    SelectedTypeName="Objects.Other.RenderMaterial",
    UseSchemaTag=False,
    UserSetSchemaTag=False,
    seed="6f203a072cfea5a7e1e1")
cso_5 = CreateSpeckleObject(Wall_geometry=brep_2, selectedKitName="Objects")
# You could replicate this type of structure in Speckle like so 👇
# 
# Conceptual building using nested speckle objects to organise, categorise and label the data.
# 
# If you receive this structure from someone else, you just need to expand it until you reach the data you need 👇🏼
# 
# Doing the inverse operation: starting from the "building" and expanding down to the unit values.
wall = Wall(
    Height=python_2.Height,
    BaseLine=flatten(ln),
    Thickness=python_2.Thickness,
    Level=level,
    NumberCode=panel_5,
    ProjectInformation=eso,
    Surface=flatten(item_8),
    Material=rendermaterial,
    A=cso_5,
    SelectedConstructorName="Objects.BuiltElements.Wall.ctor(System.Double,Objects.ICurve,System.Collections.Generic.List`1[Speckle.Core.Models.Base])",
    SelectedTypeName="Objects.BuiltElements.Wall",
    UseSchemaTag=False,
    UserSetSchemaTag=True,
    seed="a3bcf4127012e3fe4be9")  # -> flatten(SpeckleObject)

# ---- group: REVIT_Wall
sso = RevitWallByCurveAndHeight(
    Family=panel_5,
    Type="Implenia_wall",
    BaseLine=ln,
    Level=level,
    Height=python_2.Height,
    BaseOffset=0,
    TopOffset=0,
    Flipped=False,
    Structural=False,
    Thickness=python_2.Thickness,
    SelectedConstructorName="Objects.BuiltElements.Revit.RevitWall.ctor(System.String,System.String,Objects.ICurve,Objects.BuiltElements.Level,System.Double,System.Double,System.Double,System.Boolean,System.Boolean,System.Collections.Generic.List`1[Speckle.Core.Models.Base],System.Collections.Generic.List`1[Objects.BuiltElements.Revit.Parameter])",
    SelectedTypeName="Objects.BuiltElements.Revit.RevitWall",
    UseSchemaTag=False,
    UserSetSchemaTag=False,
    seed="73301769be48de9a2ede")

# ----
eso_3 = ExtendSpeckleObject(
    SpeckleObject=extr_2,
    Type="SLA_21",
    Category="SLAB",
    Outline=crv_3,
    Thickness="-0.15",
    Level=level,
    ProjectInformation=eso,
    ElementInformation=eso_2,
    selectedKitName="Objects")  # -> flatten(ExtendedSpeckleObject)
eso_4 = ExtendSpeckleObject(
    SpeckleObject=brep_2,
    Type=panel_5,
    Category="Walls",
    Baseline=ln,
    Thickness=python_2.Thickness,
    Level=level,
    ApartmentName=python_2.RoomType,
    RoomName=python_2.RoomType,
    RoomHeight=panel_6,
    ProjectInformation=eso,
    ElementInformation=eso_2,
    selectedKitName="Objects")  # -> flatten(ExtendedSpeckleObject)
cso_6 = CreateSpeckleObject(Floors=eso_3, Walls=eso_4, selectedKitName="Objects")

send = Send(
    Stream=sget,
    Message=message,
    Data=cso_6,
    AutoSend=False,
    BaseId="251fe3be066f2a7fd52ae77e43311b4d",
    CurrentComponentState="expired",
    KitName="Objects",
    OutputWrappers="https://app.speckle.systems\tb9d01cae98\t0227d45a21",
    UseDefaultCache=True,
    selectedKitName="Objects")

# ==== cluster StrainghtenPolyLin
vec = ClusterInput()
pt = ClusterInput()
vec_2 = Vector(vec)
pt_2 = Point(pt)
pt_3 = Point(pt)
devec = DeconstructVector(Vector=vec_2)  # -> XComponent, YComponent, ZComponent
lng = ListLength(List=pt_2)
round = Round(Number=devec.XComponent)  # -> Nearest, Floor, Ceiling
round_2 = Round(Number=devec.YComponent)  # -> Nearest, Floor, Ceiling
round_3 = Round(Number=devec.ZComponent)  # -> Nearest, Floor, Ceiling
culln = CullNth(List=pt_3, CullFrequency=lng)
vec_3 = VectorXYZ(XComponent=round.Nearest, YComponent=round_2.Nearest, ZComponent=round_3.Nearest)  # -> Vector, Length
number_slider = Slider(66, range=1..100)
line = LineSDL(Start=culln, Direction=vec_3.Vector, Length="1")
ext = ExtendCurve(Curve=line, Type=0, Start=number_slider, End=number_slider)
ccx = CurveCurve(CurveA=ext, CurveB=graft(ext))  # -> Points, ParamsA, ParamsB
cp = ClosestPoint(Point=pt_3, Cloud=flatten(ccx.Points))  # -> ClosestPoint, CPIndex, Distance
pline = PolyLine(Vertices=cp.ClosestPoint, Closed=False)
pl = ClusterOutput(pline)
